# Grasshopper definition test.gh (Grasshopper 1.0.7)

crv = Curve(<curve referenced from the Rhino model>)
boundary = BoundarySurfaces(Edges=crv)
Z = UnitZ(Factor=Slider(2, range=0..10))
extr = Extrude(Base=boundary, Direction=Z)
mesh = MeshBrep(
    Brep=extr,
    Settings={GridMaxCount=0, GridMinCount=16, JaggedSeams=False, MaxEdgeLength=0, MinEdgeLength=0.0001, MinTolerance=0, Refine=True, RefineAngle=0, RelativeTolerance=0.65, SimplePlanes=True, Tolerance=0})
tri = Triangulate(Mesh=mesh)  # -> Mesh, Count
